# Grasshopper definition iphone drawing remote.gh (Grasshopper 0.9.76)
# plug-ins: gHowl, setFlounderCamera

# ----
# Wand Input
panel = Panel("999")
netsource = NetworkSource()  # -> NetworkAdapterIsUp, AdapterProperties, LocalIpAddress
udp = UDPReceiver(Address=netsource.LocalIpAddress, Port="1234", Pattern=panel)  # -> Info, Data
panel_2 = Panel(udp.Data)
accxyz = OSCChannel(OSCMessage=udp.Data)
panel_3 = Panel(accxyz)

rec = DataRecorder(accxyz, DataLimit=-10, RecordData=True)  # disabled
intcrv = Interpolate(Vertices=rec, Degree=3, Periodic=False, KnotStyle=1)  # -> Curve, Length, Domain; disabled
number_slider = Slider(1, range=0..1)  # disabled
bbox = BoundingBox(Content=intcrv.Curve, Plane=PlaneXY(0, 0, 0))  # -> Box, Box_2; disabled
boxprop = BoxProperties(Box=bbox.Box)  # -> Center, Diagonal, Area, Volume, Degeneracy; disabled
panel_4 = Panel(intcrv.Curve)  # disabled
vlen = VectorLength(Vector=boxprop.Diagonal)  # disabled
panel_5 = Panel(boxprop.Diagonal)  # disabled
division = Division(A=number_slider, B=vlen)  # disabled
number_slider_2 = Slider(27, range=0..100)  # disabled
multiplication = Multiplication(A=division, B=number_slider_2)  # disabled
scale = Scale(Geometry=intcrv.Curve, Center=Point(0, 0, 0), Factor=multiplication)  # -> Geometry, Transform; disabled

wall_height = Slider(13, range=0..20)

# ----
# Wand Trail
number_slider_3 = Slider(800, range=0..1000)
rec_2 = DataRecorder(accxyz, DataLimit=-10, RecordData=True)
pline = PolyLine(Vertices=rec_2, Closed=False)
scale_2 = Scale(Geometry=pline, Center=Point(0, 0, 0), Factor=number_slider_3)  # -> Geometry, Transform

# ----
# Arch Builder
number_slider_4 = Slider(8, range=0..10)
neg = Negative(Value=number_slider_4)
Y = UnitY(Factor=Slider(7, range=0..10))
Y_2 = UnitY(Factor=neg)
move = Move(Geometry=scale_2.Geometry, Motion=Y)  # -> Geometry, Transform
Z = UnitZ(Factor=wall_height)
move_2 = Move(Geometry=scale_2.Geometry, Motion=Y_2)  # -> Geometry, Transform
extr = Extrude(Base=[move.Geometry, move_2.Geometry], Direction=Z)
loft = Loft(
    Curves=[move.Geometry, move_2.Geometry],
    Options={Adjust=False, Closed=False, LoftEnds=0, LoftSimp=0, LoftType=0, Rebuild=10, Refit=0.01})
floor_color = ColourSwatch(SwatchColor=RGB(134, 118, 187))
wall_color = ColourSwatch(SwatchColor=RGB(237, 121, 222))
floor_plate = CustomPreview(Geometry=loft, Shader=floor_color)
walls = CustomPreview(Geometry=extr, Shader=wall_color)

panel_6 = Panel(rec_2)
take_accl_gyro_data_from_phone = Data()
phone = Data()
panel_7 = Panel(extr)
analyze_sort_curve = Data(phone)
# The Magic Wand
# The Magic Wand
draw_a_curve = Data(take_accl_gyro_data_from_phone)
bbox_2 = BoundingBox(Content=extr, Plane=PlaneXY(0, 0, 0))  # -> Box, Box_2
panel_8 = Panel(bbox_2.Box)
geo = Geometry(scale_2.Geometry)
analyze_curve_for_straightness = Data(analyze_sort_curve)
Z_2 = UnitZ(Factor=Slider(5, range=0..10))
analyze_curve_for_3d = Data(analyze_sort_curve)
movecameratoheadheight = Move(Geometry=geo, Motion=Z_2)  # -> Geometry, Transform

wanderer_path = Slider(0.44, range=0..1)
eval = EvaluateCurve(Curve=reparameterize(movecameratoheadheight.Geometry), Parameter=wanderer_path)  # -> Point, Tangent, Angle
multiplication_2 = Multiplication(A=Slider(40, range=0..40), B=eval.Tangent)
move_3 = Move(Geometry=eval.Point, Motion=multiplication_2)  # -> Geometry, Transform
sph = Sphere(Base=eval.Point, Radius=Slider(0, range=0..3))
camera_target = Geometry(move_3.Geometry)
ln = Line(StartPoint=eval.Point, EndPoint=move_3.Geometry)
preview = CustomPreview(
    Geometry=sph,
    Shader={ambient=RGB(0, 0, 0), diffuse=RGB(255, 105, 180), emission=RGB(76, 32, 54), shine=0.5, specular=RGB(255, 255, 255), transparency=0})
timer = Timer(TimerInterval=20, Target=syncfloundercamera)
Z_3 = UnitZ(Factor=1)
syncfloundercamera = SyncFlounderCamera(
    Activate=Toggle(False),
    ViewportName="Bounding",
    Location=eval.Point,
    Target=camera_target,
    Lens=Slider(19, range=0..100),
    Up=Z_3)

wanderer_path_2 = Slider(0.44, range=0..1)
eval_2 = EvaluateCurve(Curve=reparameterize(movecameratoheadheight.Geometry), Parameter=wanderer_path_2)  # -> Point, Tangent, Angle
multiplication_3 = Multiplication(A=Slider(40, range=0..40), B=eval_2.Tangent)
move_4 = Move(Geometry=eval_2.Point, Motion=multiplication_3)  # -> Geometry, Transform
sph_2 = Sphere(Base=eval_2.Point, Radius=Slider(0, range=0..3))
camera_target_2 = Geometry(move_4.Geometry)
ln_2 = Line(StartPoint=eval_2.Point, EndPoint=move_4.Geometry)
preview_2 = CustomPreview(
    Geometry=sph_2,
    Shader={ambient=RGB(0, 0, 0), diffuse=RGB(255, 105, 180), emission=RGB(76, 32, 54), shine=0.5, specular=RGB(255, 255, 255), transparency=0})
timer_2 = Timer(TimerInterval=20, Target=syncfloundercamera_2)
Z_4 = UnitZ(Factor=1)
syncfloundercamera_2 = SyncFlounderCamera(
    Activate=Toggle(False),
    ViewportName="flounder",
    Location=eval_2.Point,
    Target=camera_target_2,
    Lens=Slider(19, range=0..100),
    Up=Z_4)

geo_2 = Geometry(bbox_2.Box)
item = ListItem(List=bbox_2.Box, Index=0, Wrap=True)
if_3d_curve_make_spheres = Data(analyze_curve_for_3d)
if_long_make_spheres_bigger = Data([if_3d_curve_make_spheres, analyze_curve_for_3d])
panel_9 = Panel(geo_2)
analyze_curve = Data(draw_a_curve)
if_straight_extrude = Data(analyze_curve_for_straightness)
if_long_extrude_further = Data([if_straight_extrude, analyze_curve_for_straightness])
geo_3 = Geometry(item)
area = Area(Geometry=geo_3)  # -> Area, Centroid
panel_10 = Panel(item)
panel_11 = Panel(area.Centroid)
flat_geometry = Data(if_long_extrude_further)
blobby_geometry = Data(if_long_make_spheres_bigger)
# Camera
number_slider_5 = Slider(4, range=0..10)
panel_12 = Panel(eval.Point)
pt = Point(area.Centroid)
generate_differences = Data(analyze_curve)
Z_5 = UnitZ(Factor=Slider(9, range=0..100))
number_slider_6 = Slider(7, range=0..100)
neg_2 = Negative(Value=number_slider_5)
move_5 = Move(Geometry=area.Centroid, Motion=Z_5)  # -> Geometry, Transform
Z_6 = UnitZ(Factor=neg_2)
# crvs to test
fight_differences = Data(generate_differences)
multiplication_4 = Multiplication(A=Slider(1, range=0..10), B=move_5.Geometry)
Z_7 = UnitZ(Factor=number_slider_6)
panel_13 = Panel(multiplication_4)

person = Geometry(<brep referenced from the Rhino model>)
move_6 = Move(Geometry=person, Motion=eval_2.Point)  # -> Geometry, Transform
move_7 = Move(Geometry=move_6.Geometry, Motion=Z_6)  # -> Geometry, Transform
wanderer_color = ColourSwatch(SwatchColor=RGB(33, 16, 0))
person_preview = CustomPreview(Geometry=move_7.Geometry, Shader=wanderer_color)

move_8 = Move(Geometry=eval_2.Point, Motion=Z_6)  # -> Geometry, Transform
Y_3 = UnitY(Factor=number_slider_6)
pt_2 = Point(<point referenced from the Rhino model>)
syncfloundercamera_3 = SyncFlounderCamera(Activate=Toggle(True), ViewportName="Bounding2", Location=pt_2, Target=pt, Lens=Slider(33, range=0..100), Up=Y_3)
timer_3 = Timer(TimerInterval=1000, Target=syncfloundercamera_3)
dots = DotDisplay(Colour=RGB(0, 0, 0), Size=Slider(1, range=0..10))
