# Grasshopper definition iphone drawing remote_v1.gh (Grasshopper 0.9.76)
# plug-ins: gHowl, setFlounderCamera

# ----
# Wand Input
panel = Panel("999")
netsource = NetworkSource()  # -> NetworkAdapterIsUp, AdapterProperties, LocalIpAddress
udp = UDPReceiver(Address=netsource.LocalIpAddress, Port="1234", Pattern=panel)  # -> Info, Data
panel_2 = Panel(udp.Data)
accxyz = OSCChannel(OSCMessage=udp.Data)
panel_3 = Panel(accxyz)

divisionsincurve = Slider(15, range=0..100)  # disabled

rec = DataRecorder(accxyz, DataLimit=-10, RecordData=True)  # disabled
intcrv = Interpolate(Vertices=rec, Degree=3, Periodic=False, KnotStyle=1)  # -> Curve, Length, Domain; disabled
number_slider = Slider(1, range=0..1)  # disabled
panel_4 = Panel(intcrv.Curve)  # disabled
bbox = BoundingBox(Content=intcrv.Curve, Plane=PlaneXY(0, 0, 0))  # -> Box, Box_2; disabled
boxprop = BoxProperties(Box=bbox.Box)  # -> Center, Diagonal, Area, Volume, Degeneracy; disabled
vlen = VectorLength(Vector=boxprop.Diagonal)  # disabled
panel_5 = Panel(boxprop.Diagonal)  # disabled
division = Division(A=number_slider, B=vlen)  # disabled
number_slider_2 = Slider(27, range=0..100)  # disabled
multiplication = Multiplication(A=division, B=number_slider_2)  # disabled
scale = Scale(Geometry=intcrv.Curve, Center=Point(0, 0, 0), Factor=multiplication)  # -> Geometry, Transform; disabled

# ----
# Sample Curve
samplecurve = Geometry(<curve referenced from the Rhino model>)  # disabled
Z = UnitZ(Factor=Slider(5, range=0..10))
curveoutofpoints = CurveOutOfPoints(C=samplecurve, N=divisionsincurve)  # disabled

# ----
# Wand Trail
number_slider_3 = Slider(800, range=0..1000)
rec_2 = DataRecorder(accxyz, DataLimit=-10, RecordData=True)
pline = PolyLine(Vertices=rec_2, Closed=False)
scale_2 = Scale(Geometry=pline, Center=Point(0, 0, 0), Factor=number_slider_3)  # -> Geometry, Transform

geo = Geometry(scale_2.Geometry)
move = Move(Geometry=geo, Motion=Z)  # -> Geometry, Transform

eval = EvaluateCurve(Curve=reparameterize(move.Geometry), Parameter=Slider(0.54, range=0..1))  # -> Point, Tangent, Angle
multiplication_2 = Multiplication(A=Slider(40, range=0..40), B=eval.Tangent)
move_2 = Move(Geometry=eval.Point, Motion=multiplication_2)  # -> Geometry, Transform
camera_target = Geometry(move_2.Geometry)
sph = Sphere(Base=eval.Point, Radius=Slider(3, range=0..3))
ln = Line(StartPoint=eval.Point, EndPoint=move_2.Geometry)
preview = CustomPreview(
    Geometry=sph,
    Shader={ambient=RGB(0, 0, 0), diffuse=RGB(255, 105, 180), emission=RGB(76, 32, 54), shine=0.5, specular=RGB(255, 255, 255), transparency=0})
Z_2 = UnitZ(Factor=1)
timer = Timer(TimerInterval=20, Target=syncfloundercamera)
syncfloundercamera = SyncFlounderCamera(
    Activate=Toggle(True),
    ViewportName="flounder",
    Location=eval.Point,
    Target=camera_target,
    Lens=Slider(35, range=0..100),
    Up=Z_2)

panel_6 = Panel(rec_2)
number_slider_4 = Slider(3, range=0..10)
join = JoinCurves(Curves=scale_2.Geometry, Preserve=False)
take_accl_gyro_data_from_phone = Data()
Y = UnitY(Factor=Slider(6, range=0..10))
neg = Negative(Value=number_slider_4)
number_slider_5 = Slider(10, range=0..10)
neg_2 = Negative(Value=number_slider_5)
phone = Data()
offset = Offset(Curve=scale_2.Geometry, Distance=neg, Plane=PlaneXY(0, 0, 0), Corners=1)
Y_2 = UnitY(Factor=neg_2)
offset_2 = Offset(Curve=join, Distance=number_slider_4, Plane=PlaneXY(0, 0, 0), Corners=1)
move_3 = Move(Geometry=scale_2.Geometry, Motion=Y)  # -> Geometry, Transform
Z_3 = UnitZ(Factor=Slider(5, range=0..10))
move_4 = Move(Geometry=scale_2.Geometry, Motion=Y_2)  # -> Geometry, Transform
Z_4 = UnitZ(Factor=number_slider_5)
panel_7 = Panel(offset_2)
analyze_sort_curve = Data(phone)
extr = Extrude(Base=[move_3.Geometry, move_4.Geometry], Direction=Z_4)
extr_2 = Extrude(Base=[offset_2, offset], Direction=Z_3)
# The Magic Wand
# The Magic Wand
draw_a_curve = Data(take_accl_gyro_data_from_phone)
loft = Loft(
    Curves=flatten(offset_2),
    Options={Adjust=False, Closed=False, LoftEnds=0, LoftSimp=0, LoftType=0, Rebuild=10, Refit=0.01})
loft_2 = Loft(
    Curves=[move_3.Geometry, move_4.Geometry],
    Options={Adjust=False, Closed=False, LoftEnds=0, LoftSimp=0, LoftType=0, Rebuild=10, Refit=0.01})
number_slider_6 = Slider(800, range=0..1000)  # disabled
loft_3 = Loft(Options={Adjust=False, Closed=False, LoftEnds=0, LoftSimp=0, LoftType=0, Rebuild=10, Refit=0.01})
shader = Shader()
preview_2 = CustomPreview(Geometry=loft, Shader=ColourSwatch(SwatchColor=RGB(237, 121, 222)))
preview_3 = CustomPreview(Geometry=extr, Shader=ColourSwatch(SwatchColor=RGB(237, 121, 222)))
preview_4 = CustomPreview(
    Geometry=extr_2,
    Shader={ambient=RGB(0, 0, 0), diffuse=RGB(255, 105, 180), emission=RGB(76, 32, 54), shine=0.5, specular=RGB(255, 255, 255), transparency=0})
panel_8 = Panel(loft)

number_slider_7 = Slider(100, range=0..100)  # disabled
len = Length(Curve=geo)  # disabled
# Short?
panel_9 = Panel(len)  # disabled
smaller = SmallerThan(FirstNumber=len, SecondNumber=number_slider_7)  # -> SmallerThan, OrEqualTo; disabled
panel_10 = Panel(smaller.SmallerThan)  # disabled
cull = CullPattern(List=geo, CullPattern=smaller.SmallerThan)  # disabled
shortcurve = Geometry(cull)  # disabled
panel_11 = Panel(shortcurve)  # disabled

disc = Discontinuity(Level=2)  # -> Points, Parameters; disabled
preview_5 = CustomPreview(Geometry=loft_2, Shader=ColourSwatch(SwatchColor=RGB(237, 54, 187)))

# ----
# Blobby
number_slider_8 = Slider(44, range=0..100)  # disabled
len_2 = Length(Curve=shortcurve)  # disabled
division_2 = Division(A=len_2, B=20)  # disabled
division_3 = Division(A=len_2, B=number_slider_8)  # disabled
divide = DivideCurve(Curve=shortcurve, Count=division_3, Kinks=False)  # -> Points, Tangents, Parameters; disabled
sph_2 = Sphere(Base=divide.Points, Radius=division_2)  # disabled

crv = Curve()  # disabled
panel_12 = Panel(disc.Points)  # disabled
item = ListItem(List=disc.Parameters, Index=1, Wrap=True)  # disabled
analyze_curve_for_straightness = Data(analyze_sort_curve)
if_lots_of_variation_in_curve = Data()  # disabled
analyze_curve_for_3d = Data(analyze_sort_curve)
number_slider_9 = Slider(20, range=0..100)  # disabled
panel_13 = Panel(item)  # disabled
if_3d_curve_make_spheres = Data(analyze_curve_for_3d)
if_long_make_spheres_bigger = Data([if_3d_curve_make_spheres, analyze_curve_for_3d])
# Swirlify
add_squigly_elements = Data(if_lots_of_variation_in_curve)  # disabled
swatch = ColourSwatch(SwatchColor=RGB(255, 255, 255))  # disabled
analyze_curve = Data(draw_a_curve)
if_straight_extrude = Data(analyze_curve_for_straightness)
if_long_extrude_further = Data([if_straight_extrude, analyze_curve_for_straightness])
smaller_2 = SmallerThan(FirstNumber=item, SecondNumber=number_slider_9)  # -> SmallerThan, OrEqualTo; disabled
preview_6 = CustomPreview(Geometry=sph_2, Shader=swatch)  # disabled
offset_extrusion_baed_on_length = Data()  # disabled
flat_geometry = Data(if_long_extrude_further)
blobby_geometry = Data(if_long_make_spheres_bigger)
cull_2 = CullPattern(List=curveoutofpoints, CullPattern=smaller_2.SmallerThan)  # disabled
geo_2 = Geometry(cull_2)  # disabled
panel_14 = Panel(cull_2)  # disabled
generate_differences = Data(analyze_curve)

panel_15 = Panel("False")  # disabled
nor = GateNor(A=smaller.SmallerThan, B=panel_15)  # disabled
panel_16 = Panel(nor)  # disabled
# Long
cull_3 = CullPattern(List=scale_2.Geometry, CullPattern=nor)  # disabled
lomgcurve = Geometry(cull_3)  # disabled

# ----
# Spindly
scale_3 = Scale(Geometry=lomgcurve, Center=Point(0, 0, 0), Factor=0.5)  # -> Geometry, Transform; disabled
number_slider_10 = Slider(0.301, range=0..1)  # disabled
tweencrv = TweenCurve(CurveA=lomgcurve, CurveB=scale_3.Geometry, Factor=number_slider_10, BlendType=0)  # disabled
tweencrv_2 = TweenCurve(CurveA=tweencrv, CurveB=scale_3.Geometry, Factor=number_slider_10, BlendType=0)  # disabled
tweencrv_3 = TweenCurve(CurveA=tweencrv_2, CurveB=scale_3.Geometry, Factor=number_slider_10, BlendType=0)  # disabled
multiplication_3 = Multiplication(A=number_slider_10, B=len)  # disabled
tweencrv_4 = TweenCurve(CurveA=tweencrv_3, CurveB=scale_3.Geometry, Factor=number_slider_10, BlendType=0)  # disabled
panel_17 = Panel(multiplication_3)  # disabled
tweencrv_5 = TweenCurve(CurveA=tweencrv_4, CurveB=scale_3.Geometry, Factor=number_slider_10, BlendType=0)  # disabled

number_slider_11 = Slider(20, range=0..100)  # disabled
number_slider_12 = Slider(0, range=0..100)  # disabled
gradient = Gradient(
    LowerLimit=number_slider_12,
    UpperLimit=number_slider_11,
    Parameter=multiplication_3,
    stops=[0: RGB(0, 98, 0), 0.25: RGB(81, 175, 17), 0.5: RGB(159, 198, 146), 0.75: RGB(170, 235, 41), 1: RGB(221, 255, 53)])  # disabled
preview_7 = CustomPreview(Geometry=[tweencrv_5, tweencrv_4, tweencrv_3, tweencrv_2, tweencrv, scale_3.Geometry, lomgcurve], Shader=gradient)  # disabled

fight_differences = Data(generate_differences)
if_low_difference_in_z_values = Data()  # disabled
number_slider_13 = Slider(1, range=0..1)  # disabled
divide_2 = DivideCurve(Curve=lomgcurve, Count=10, Kinks=False)  # -> Points, Tangents, Parameters; disabled
panel_18 = Panel(lomgcurve)  # disabled
# Flatify
extrude_curve = Data(if_low_difference_in_z_values)  # disabled
offset_extrusion_baed_on_length_2 = Data([extrude_curve, if_low_difference_in_z_values])  # disabled
pt = Point(divide_2.Points)  # disabled
eval_2 = EvaluateCurve(Curve=lomgcurve, Parameter=number_slider_13)  # -> Point, Tangent, Angle; disabled
pipeline = GeometryPipeline(
    GroupByLayer=False,
    GroupByType=False,
    IncludeHidden=True,
    IncludeLocked=True,
    LayerFilter="Scribbles",
    NameFilter="*",
    TypeFilter=1)

# ----
# crvs to test
fast_peak_crv = Geometry(<curve referenced from the Rhino model>)
long_vert_crv = Geometry(<curve referenced from the Rhino model>)
straight_crv = Geometry(<curve referenced from the Rhino model>)
_4_peak_crv = Geometry(<curve referenced from the Rhino model>)
_2_peak_crv = Geometry(<curve referenced from the Rhino model>)
closed_crv = Geometry(<curve referenced from the Rhino model>)
divide_3 = DivideCurve(Curve=_2_peak_crv, Count=20, Kinks=False)  # -> Points, Tangents, Parameters
divide_4 = DivideCurve(Curve=_4_peak_crv, Count=20, Kinks=False)  # -> Points, Tangents, Parameters
divide_5 = DivideCurve(Curve=closed_crv, Count=20, Kinks=False)  # -> Points, Tangents, Parameters
divide_6 = DivideCurve(Curve=straight_crv, Count=20, Kinks=False)  # -> Points, Tangents, Parameters
divide_7 = DivideCurve(Curve=fast_peak_crv, Count=20, Kinks=False)  # -> Points, Tangents, Parameters
divide_8 = DivideCurve(Curve=long_vert_crv, Count=20, Kinks=False)  # -> Points, Tangents, Parameters
intcrv_2 = Interpolate(Vertices=divide_3.Points, Degree=3, Periodic=False, KnotStyle=1)  # -> Curve, Length, Domain
intcrv_3 = Interpolate(Vertices=divide_4.Points, Degree=3, Periodic=False, KnotStyle=1)  # -> Curve, Length, Domain
intcrv_4 = Interpolate(Vertices=divide_5.Points, Degree=3, Periodic=False, KnotStyle=1)  # -> Curve, Length, Domain
intcrv_5 = Interpolate(Vertices=divide_6.Points, Degree=3, Periodic=False, KnotStyle=1)  # -> Curve, Length, Domain
intcrv_6 = Interpolate(Vertices=divide_7.Points, Degree=3, Periodic=False, KnotStyle=1)  # -> Curve, Length, Domain
intcrv_7 = Interpolate(Vertices=divide_8.Points, Degree=3, Periodic=False, KnotStyle=1)  # -> Curve, Length, Domain
_2_peak_crv_2 = Geometry(intcrv_2.Curve)
closed_crv_2 = Geometry(intcrv_4.Curve)
long_vert_crv_2 = Geometry(intcrv_7.Curve)
straight_crv_2 = Geometry(intcrv_5.Curve)
_4_peak_crv_2 = Geometry(intcrv_3.Curve)

# ----
# TestingGrounds
cp = ControlPoints(Curve=long_vert_crv)  # -> Points, Weights, Knots
fast_peak_crv_2 = Geometry(intcrv_6.Curve)
panel_19 = Panel(cp.Weights)
disc_2 = Discontinuity(Curve=straight_crv_2, Level=2)  # -> Points, Parameters
item_2 = ListItem(List=disc_2.Parameters, Index=1, Wrap=True)
panel_20 = Panel(item_2)
panel_21 = Panel(disc_2.Points)
smaller_3 = SmallerThan(FirstNumber=item_2, SecondNumber=Slider(20, range=0..100))  # -> SmallerThan, OrEqualTo
extr_3 = Extrude()
cull_4 = CullPattern(List=straight_crv_2, CullPattern=smaller_3.SmallerThan)
panel_22 = Panel(cull_4)
geo_3 = Geometry(cull_4)
curvature = Curvature(Parameter=Slider(7, range=0..100))  # -> P, K, C
pframe = PerpFrame(Parameter=Slider(5, range=0..10))
panel_23 = Panel(curvature.P)
Z_5 = UnitZ(Factor=Slider(4, range=0..10))
extr_4 = Extrude(Base=geo_3, Direction=Z_5)

# ==== cluster CurveOutOfPoints
C = ClusterInput()
N = ClusterInput()
divide = DivideCurve(Curve=C, Count=N, Kinks=False)  # -> Points, Tangents, Parameters
pt = Point(divide.Points)
intcrv = Interpolate(Vertices=pt, Degree=3, Periodic=False, KnotStyle=1)  # -> Curve, Length, Domain
C_2 = ClusterOutput(intcrv.Curve)
